# Grasshopper definition 021723_Pyramid Pattern.ghx (Grasshopper 1.0.7)

number_slider = Slider(50, range=0..50)
c_script = CSharpScript(row=number_slider, spaceX=Slider(4.29, range=0..10), spaceY=Slider(0, range=0..10))  # -> out, A; inputs row: Int32, spaceX: Double, spaceY: Double
# ---------- c_script: C# ----------
    List<Point3d> Tree = new List<Point3d>();
    for(int i = 0; i < row; i++)
    {
      //initialise
      double x = 0;
      double y = 0;
      double z = 0;

      //spaces
      x = spaceX * (row - 1 - i);
      y = spaceY * (row - 1 - i);

      for(int j = 1; j <= (i * 2 + 1); j++)
      {
        x += spaceX;
        Tree.Add(new Point3d(x, y, z));
      }

    }

    A = Tree;
# ---------- end c_script ----------
division = Division(A=number_slider, B=2)
cir = Circle(Plane=c_script.A, Radius=c_script.A)
preview = CustomPreview(Geometry=cir, Material=ColourSwatch(SwatchColor=RGBA(0, 0, 0, 54)))
