# Grasshopper definition 05172025_GH Playground_Ep1_timer.gh (Grasshopper 1.0.8)

trigger = Trigger(Interval=50, TimerInterval=50, Target=timer)  # disabled
# Moving Curve
button = Button()
crv = Curve(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)
timer = CSharpScript(reset=button, Pause=Toggle(False), step=Slider(0.05, range=0..5))  # -> out, a; inputs reset: Boolean, Pause: Boolean, step: Double
# ---------- timer: C# ----------
// Grasshopper Script Instance
#region Usings
using System;
using System.Linq;
using System.Collections;
using System.Collections.Generic;
using System.Drawing;

using Rhino;
using Rhino.Geometry;

using Grasshopper;
using Grasshopper.Kernel;
using Grasshopper.Kernel.Data;
using Grasshopper.Kernel.Types;
#endregion

public class Script_Instance : GH_ScriptInstance
{
    #region Notes
    /* 
      Members:
        RhinoDoc RhinoDocument
        GH_Document GrasshopperDocument
        IGH_Component Component
        int Iteration

      Methods (Virtual & overridable):
        Print(string text)
        Print(string format, params object[] args)
        Reflect(object obj)
        Reflect(object obj, string method_name)
    */
    #endregion

    double time =0.0;
    private void RunScript(bool reset, bool Pause, double step, ref object a)
    {
        // Write your logic here
        if(reset)//如果重整==True
        {
            time = 0.0; //time歸零
        }
        a = time;

        if(Pause) //如果暫停==True
        {
            time = time;
        }else
        {
            //time++;
            time += step; //改成每次增加我們設置的step
        }

    }

}
# ---------- end timer ----------
divide = DivideCurve(Curve=crv, Count=Slider(11, range=0..100), Kinks=False)  # -> Points, Tangents, Parameters
panel = Panel(timer.a)
curves = CSharpScript(time=timer.a, amplitude=Slider(10, range=0..10), BasePts=divide.Points)  # -> out, a; inputs time: Double, amplitude: Double, BasePts: list of Point3d
# ---------- curves: C# ----------
// Grasshopper Script Instance
#region Usings
using System;
using System.Linq;
using System.Collections;
using System.Collections.Generic;
using System.Drawing;

using Rhino;
using Rhino.Geometry;

using Grasshopper;
using Grasshopper.Kernel;
using Grasshopper.Kernel.Data;
using Grasshopper.Kernel.Types;
#endregion

public class Script_Instance : GH_ScriptInstance
{
    #region Notes
    /* 
      Members:
        RhinoDoc RhinoDocument
        GH_Document GrasshopperDocument
        IGH_Component Component
        int Iteration

      Methods (Virtual & overridable):
        Print(string text)
        Print(string format, params object[] args)
        Reflect(object obj)
        Reflect(object obj, string method_name)
    */
    #endregion

    private void RunScript(
		double time,
		double amplitude,
		List<Point3d> BasePts,
		ref object a)
    {
        // Write your logic here
        List<Point3d>newPoints = new List<Point3d>();

        for (int i = 0; i < BasePts.Count; i++) {
        double offset = Math.Sin(time + i * 0.3) * amplitude;
        Point3d p = BasePts[i];
        newPoints.Add(new Point3d(p.X, p.Y + offset, p.Z)); 

        a = newPoints;
    }
         
    }

}
# ---------- end curves ----------
intcrv = Interpolate(Vertices=curves.a, Degree=3, Periodic=False, KnotStyle=1)  # -> Curve, Length, Domain

# ----
# Moving Point
button_2 = Button()
trigger_2 = Trigger(Interval=50, TimerInterval=50, Target=timer_2)  # disabled
timer_2 = CSharpScript(reset=button_2, Pause=Toggle(True), step=Slider(0.47, range=0..5))  # -> out, a; inputs reset: Boolean, Pause: Boolean, step: Double
# ---------- timer_2: C# ----------
// Grasshopper Script Instance
#region Usings
using System;
using System.Linq;
using System.Collections;
using System.Collections.Generic;
using System.Drawing;

using Rhino;
using Rhino.Geometry;

using Grasshopper;
using Grasshopper.Kernel;
using Grasshopper.Kernel.Data;
using Grasshopper.Kernel.Types;
#endregion

public class Script_Instance : GH_ScriptInstance
{
    #region Notes
    /* 
      Members:
        RhinoDoc RhinoDocument
        GH_Document GrasshopperDocument
        IGH_Component Component
        int Iteration

      Methods (Virtual & overridable):
        Print(string text)
        Print(string format, params object[] args)
        Reflect(object obj)
        Reflect(object obj, string method_name)
    */
    #endregion

    double time =0.0;
    private void RunScript(bool reset, bool Pause, double step, ref object a)
    {
        // Write your logic here
        if(reset)//如果重整==True
        {
            time = 0.0; //time歸零
        }
        a = time;

        if(Pause) //如果暫停==True
        {
            time = time;
        }else
        {
            //time++;
            time += step; //改成每次增加我們設置的step
        }
         
    }

}
# ---------- end timer_2 ----------
point = CSharpScript(time=timer_2.a, amplitude=Slider(5, range=0..5))  # -> out, a; inputs time: Double, amplitude: Double
# ---------- point: C# ----------
// Grasshopper Script Instance
#region Usings
using System;
using System.Linq;
using System.Collections;
using System.Collections.Generic;
using System.Drawing;

using Rhino;
using Rhino.Geometry;

using Grasshopper;
using Grasshopper.Kernel;
using Grasshopper.Kernel.Data;
using Grasshopper.Kernel.Types;
#endregion

public class Script_Instance : GH_ScriptInstance
{
    #region Notes
    /* 
      Members:
        RhinoDoc RhinoDocument
        GH_Document GrasshopperDocument
        IGH_Component Component
        int Iteration

      Methods (Virtual & overridable):
        Print(string text)
        Print(string format, params object[] args)
        Reflect(object obj)
        Reflect(object obj, string method_name)
    */
    #endregion

    private void RunScript(double time, double amplitude, ref object a)
    {
        // Write your logic here
        double x = Math.Sin(time)* amplitude;
        Point3d outPt = new Point3d(x,0,0);
        a = outPt;
    }
}
# ---------- end point ----------
panel_2 = Panel(timer_2.a)
dots = DotDisplay(Point=point.a, Colour=ColourSwatch(SwatchColor=RGB(210, 191, 255)), Size=Slider(0.37, range=0..1))

# ----
# Timer
button_3 = Button()
trigger_3 = Trigger(Interval=50, TimerInterval=50, Target=timer_3)  # disabled
timer_3 = CSharpScript(reset=button_3, Pause=Toggle(False), step=Slider(0.47, range=0..5))  # -> out, a; inputs reset: Boolean, Pause: Boolean, step: Double; same code as timer_2
panel_3 = Panel(timer_3.a)

datarecorder = CSharpScript(Crv=intcrv.Curve, Record=Button(), ClearCrv=Button())  # -> out, a; inputs Crv: Curve, Record: Boolean, ClearCrv: Boolean
# ---------- datarecorder: C# ----------
// Grasshopper Script Instance
#region Usings
using System;
using System.Linq;
using System.Collections;
using System.Collections.Generic;
using System.Drawing;

using Rhino;
using Rhino.Geometry;

using Grasshopper;
using Grasshopper.Kernel;
using Grasshopper.Kernel.Data;
using Grasshopper.Kernel.Types;
#endregion

public class Script_Instance : GH_ScriptInstance
{
    #region Notes
    /* 
      Members:
        RhinoDoc RhinoDocument
        GH_Document GrasshopperDocument
        IGH_Component Component
        int Iteration

      Methods (Virtual & overridable):
        Print(string text)
        Print(string format, params object[] args)
        Reflect(object obj)
        Reflect(object obj, string method_name)
    */
    #endregion

    List<Curve>RecordCrv = new List<Curve>();
    private void RunScript(Curve Crv, bool Record, bool ClearCrv, ref object a)
    {
        // Write your logic here
        if(Record)RecordCrv.Add(Crv); 
        if(ClearCrv)RecordCrv.Clear();
        a = RecordCrv; 
    }
}
# ---------- end datarecorder ----------

rec = DataRecorder(intcrv.Curve, DataLimit=-10, RecordData=False)  # disabled
