# Grasshopper definition 1011_The Chaos Game.gh (Grasshopper 1.0.7)

polygon = Polygon(Plane=PlaneXY(0, 0, 0), Radius=Slider(50, range=0..100), Segments=Slider(3, range=0..10), FilletRadius=0)  # -> Polygon, Length
rotate = Rotate(Geometry=polygon.Polygon, Angle=1.570796327, Plane=PlaneXY(0, 0, 0))  # -> Geometry, Transform
explode = Explode(Curve=rotate.Geometry, Recursive=Toggle(False))  # -> Segments, Vertices
cullpt = CullDuplicates(Points=explode.Vertices, Tolerance=0.1, CullMode=3)  # -> Points, Indices, Valence
pt = Point(cullpt.Points)
c_script = CSharpScript(x=pt, iter=Slider(5000, range=0..10000))  # -> out, A; inputs x: list of Point3d, iter: Int32
# ---------- c_script: C# ----------
    List<Point3d> test = new List<Point3d>();

    Random rand = new Random();

    int ratio = 2;

    //triangle points
    Point3d FirstPts = x[2];
    Point3d SecondPts = x[0];
    Point3d ThirdPts = x[1];

    //initialPt
    Point3d initial = new Point3d((FirstPts.X + SecondPts.X) / ratio, (FirstPts.Y + SecondPts.Y) / ratio, (FirstPts.Z + SecondPts.Z) / ratio);
    test.Add(initial);

    Point3d previous = initial;

    for(int i = 0; i < iter; i++)
    {

      int randNum = rand.Next(1, 6);
      Point3d newPt = new Point3d();

      //let's roll the dice!
      if(randNum == 1 || randNum == 2)
      {
        newPt = new Point3d((FirstPts.X + previous.X) / ratio, (FirstPts.Y + previous.Y) / ratio, (FirstPts.Z + previous.Z) / ratio);
      }else if(randNum == 3 || randNum == 4)
      {
        newPt = new Point3d((SecondPts.X + previous.X) / ratio, (SecondPts.Y + previous.Y) / ratio, (SecondPts.Z + previous.Z) / ratio);
      }else
      {
        newPt = new Point3d((ThirdPts.X + previous.X) / ratio, (ThirdPts.Y + previous.Y) / ratio, (ThirdPts.Z + previous.Z) / ratio);
      }
      test.Add(newPt);
      previous = newPt;
    }

    A = test;
# ---------- end c_script ----------
cloud = CloudDisplay(Points=[c_script.A, pt], Colours=ColourSwatch(SwatchColor=RGB(255, 255, 255)), Size=Slider(1, range=1..10), SpriteType=0)
